# Grasshopper definition InitGit.gh (Grasshopper 1.0.7)
# plug-ins: Githopper

panel = Panel("C:\Users\cawn069856\Documents\IAAC\Enviro")
concatenate = Concatenate(FragmentA=panel, FragmentB="\YK_NT_Environmental\")
clone_repository = CloneRepository(URL="https://github.com/StuvX/YK_NT_Environmental.git", Location=panel, MarshallingSignalParameter=Button())
git_path = GitPath(Path=concatenate, Set=Button())  # -> Report, Help
panel_2 = Panel(clone_repository)
panel_3 = Panel(git_path.Report)
select_file = SelectFile()  # -> Files, Directory
panel_4 = Panel(select_file.Directory)
