# Grasshopper definition SolarAnalysis.gh (Grasshopper 1.0.7)

panel = Panel("https://energyplus-weather.s3.amazonaws.com/southwest_pacific_wmo_region_5/AUS/AUS_VIC.Melbourne.948660_IWEC/AUS_VIC.Melbourne.948660_IWEC.zip")
panel_2 = Panel("https://climate.onebuilding.org/WMO_Region_4_North_and_Central_America/CAN_Canada/NT_Northwest_Territories/CAN_NT_Yellowknife.AP.719360_TMYx.zip")
panel_3 = Panel("https://energyplus-weather.s3.amazonaws.com/north_and_central_america_wmo_region_4/CAN/NT/CAN_NT_Yellowknife.719360_CWEC/CAN_NT_Yellowknife.719360_CWEC.zip")
epwmap = LBEPWmap(epw_map=Toggle(True))  # -> Output; plug-in component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
downloadepw = LBDownloadWeather(weather_URL=panel)  # -> epw_file, stat_file, ddy_file; plug-in component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
downloadepw_2 = LBDownloadWeather(weather_URL=panel_3)  # -> epw_file, stat_file, ddy_file; plug-in component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
downloadepw_3 = LBDownloadWeather(weather_URL=panel_2)  # -> epw_file, stat_file, ddy_file; plug-in component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
importepw = LBImportEPW(epw_file=downloadepw_3.epw_file)  # -> location, dry_bulb_temperature, dew_point_temperature, relative_humidity, wind_speed, wind_direction, direct_normal_rad, diffuse_horizontal_rad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; plug-in component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
importepw_2 = LBImportEPW(epw_file=downloadepw.epw_file)  # -> location, dry_bulb_temperature, dew_point_temperature, relative_humidity, wind_speed, wind_direction, direct_normal_rad, diffuse_horizontal_rad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; plug-in component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
importepw_3 = LBImportEPW(epw_file=downloadepw_2.epw_file)  # -> location, dry_bulb_temperature, dew_point_temperature, relative_humidity, wind_speed, wind_direction, direct_normal_rad, diffuse_horizontal_rad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; plug-in component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
brep = Brep(<brep referenced from the Rhino model>)
data = Data(importepw_3.diffuse_horizontal_rad)
data_2 = Data(importepw_3.direct_normal_rad)
bounding_box = BoundingBox(Content=flatten(brep), Plane=PlaneXY(0, 0, 0))  # -> Box, Box_2
analysisperiod = LBAnalysisPeriod(
    start_month=Slider(1, range=1..12),
    start_day=Slider(1, range=1..31),
    start_hour=Slider(0, range=0..23),
    end_month=Slider(12, range=1..12),
    end_day=Slider(31, range=1..31),
    end_hour=Slider(23, range=0..23),
    timestep=Slider(1, range=0..1))  # -> period, hoys, dates; plug-in component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
skymatrix = LBCumulativeSkyMatrix(location=importepw_3.location, direct_rad=data_2, diffuse_rad=data)  # -> out, sky_mtx; plug-in component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
area = Area(Geometry=bounding_box.Box)  # -> Area, Centroid
brep_2 = Brep([<brep referenced from the Rhino model> x73])
skydome = LBSkyDome(sky_mtx=skymatrix.sky_mtx)  # -> out, mesh, compass, legend, title, patch_vecs, patch_values, mesh_values, vis_set; plug-in component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
sunpath = LBSunPath(location=importepw.location, hoys=analysisperiod.hoys, center_pt=area.Centroid, scale=Slider(8, range=0..10))  # -> out, vectors, altitudes, azimuths, hoys, sun_pts, analemma, daily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; plug-in component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
point = Point(Point(635405.9485, 6927438.61, 0))
plane_normal = PlaneNormal(Origin=point, ZAxis=Vector(0, 0, 1))
legendpar = LBLegendParameters(max=Slider(5000, range=0..10000), num_decimals="0", base_plane=plane_normal)  # -> leg_par; plug-in component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
unit_z = UnitZ(Factor=1)
directsunhours = LBDirectSunHours(
    vectors=flatten(sunpath.vectors),
    geometry=flatten(brep),
    context=flatten(brep_2),
    grid_size=Slider(3, range=0..10),
    offset_dist=Slider(1, range=0..10),
    legend_par=legendpar,
    run=Toggle(True))  # -> out, points, results, mesh, legend, title, int_mtx; plug-in component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
bounds = Bounds(Numbers=directsunhours.results)
mesh = Mesh(directsunhours.mesh)
panel_4 = Panel(bounds)
cluster = Cluster()

# ==== cluster Cluster
point = Point(Point(729.3883518, 80.20172908, 0))
point_2 = Point(Point(478.7673035, 86.2559337, 0))
point_3 = Point(Point(531.6056694, 156.341158, 0))
closest_point = ClosestPoint(Point=point_2, Cloud=[point_3, point])  # -> ClosestPoint, CPIndex, Distance
distance = Distance(PointA=point_3, PointB=point)
distance_2 = Distance(PointA=point_2, PointB=point)
distance_3 = Distance(PointA=point_2, PointB=point_3)
deconstruct = Deconstruct(Point=[point_2, point_3, point])  # -> XComponent, YComponent, ZComponent
division = Division(A=distance_2, B=2)
division_2 = Division(A=distance_3, B=2)
division_3 = Division(A=distance, B=2)
average = Average(Input=[distance_3, distance])
average_2 = Average(Input=deconstruct.ZComponent)
average_3 = Average(Input=deconstruct.XComponent)
average_4 = Average(Input=deconstruct.YComponent)
average_5 = Average(Input=[distance, distance_2])
average_6 = Average(Input=[distance_2, distance_3])
division_4 = Division(A=average, B=2)
division_5 = Division(A=average_6, B=2)
division_6 = Division(A=average_5, B=2)
construct_point = ConstructPoint(XCoordinate=average_3, YCoordinate=average_4, ZCoordinate=average_2)
distance_4 = Distance(PointA=point_3, PointB=construct_point)
distance_5 = Distance(PointA=point_2, PointB=construct_point)
distance_6 = Distance(PointA=point, PointB=construct_point)
circle = Circle(Plane=point, Radius=[distance_6, division_6, division, division_3])
circle_2 = Circle(Plane=point_3, Radius=[distance_4, division_4, division_2, division_3])
circle_3 = Circle(Plane=point_2, Radius=[division_5, distance_5, division_2, division])
